# Grasshopper definition Chapter3.gh (Grasshopper 1.0.7)

# ---- group: Create new Point
number_slider = Slider(51.27, range=0..100)  # disabled
number_slider_2 = Slider(19.63, range=0..100)  # disabled
number_slider_3 = Slider(79.63, range=0..100)  # disabled
c_script = CSharpScript(x=number_slider_2, y=number_slider, z=number_slider_3)  # -> out, Point; inputs x: Double, y: Double, z: Double; disabled
# ---------- c_script: C# ----------
    //create an instance of a point and initialize to x,y, and z
    Point3d pt = new Point3d (x, y, z);
    
    //assign the point "pt" to output
    Point = pt;
# ---------- end c_script ----------
panel = Panel(c_script.Point)  # disabled

# ---- group: Dissecting the Point, taking out x, y, and z
point = Point(Point(19.63, 51.27, 79.63))  # disabled
c_script_2 = CSharpScript(pt=point)  # -> out, A, B, C; inputs pt: Point3d; disabled
# ---------- c_script_2: C# ----------
    A = pt.X;
    B = pt.Y;
    C = pt.Z;
# ---------- end c_script_2 ----------
panel_2 = Panel(c_script_2.C)  # disabled
panel_3 = Panel(c_script_2.B)  # disabled
panel_4 = Panel(c_script_2.A)  # disabled

# ---- group: Creating a point and finding the distance of it to another point
point_2 = Point(Point(0, 5, 0))  # disabled
number_slider_4 = Slider(3, range=1..10)  # disabled
number_slider_5 = Slider(2, range=1..10)  # disabled
number_slider_6 = Slider(1, range=1..10)  # disabled
panel_5 = Panel(point_2)  # disabled
c_script_3 = CSharpScript(x=number_slider_6, y=number_slider_5, z=number_slider_4, other=panel_5)  # -> out, Point, Distance; inputs x: Double, y: Double, z: Double, other: Point3d; disabled
# ---------- c_script_3: C# ----------
    Point3d pt = new Point3d(x, y, z);
    double dist = pt.DistanceTo(other);
    Point = pt;
    Distance = dist;
# ---------- end c_script_3 ----------
panel_6 = Panel(c_script_3.Point)  # disabled
panel_7 = Panel(c_script_3.Distance)  # disabled

# ---- group: Creating new Point, first making it null then adding the points in there
number_slider_7 = Slider(3.1, range=0..10)  # disabled
number_slider_8 = Slider(2.1, range=0..10)  # disabled
number_slider_9 = Slider(4.1, range=0..10)  # disabled
c_script_4 = CSharpScript(x=number_slider_8, y=number_slider_7, z=number_slider_9)  # -> out, Point; inputs x: Double, y: Double, z: Double; disabled
# ---------- c_script_4: C# ----------
    //declare a new point
    Point3d newPoint = new Point3d (Point3d.Unset);

    //set "newPoint" coordinates
    newPoint.X = x;
    newPoint.Y = y;
    newPoint.Z = z;

    //assign the point coordinates to output
    Point = newPoint;
# ---------- end c_script_4 ----------
panel_8 = Panel(c_script_4.Point)  # disabled

# ---- group: Get the origin points
c_script_5 = CSharpScript()  # -> out, Origin; disabled
# ---------- c_script_5: C# ----------
    Origin = Point3d.Origin;
# ---------- end c_script_5 ----------
panel_9 = Panel(c_script_5.Origin)  # disabled

# ---- group: Moving point by Transform (Vector3d)
panel_10 = Panel("4,5,6")  # disabled
move = Move(Motion=panel_10)  # -> Geometry, Transform; disabled
point_3 = Point(Point(0, 5, 0))  # disabled
c_script_6 = CSharpScript(Point=point_3, xform=move.Transform)  # -> out, newPt; inputs Point: Point3d, xform: Transform; disabled
# ---------- c_script_6: C# ----------
    Point3d pt = new Point3d(Point);
    pt.Transform(xform);
    newPt = pt;
# ---------- end c_script_6 ----------
panel_11 = Panel(c_script_6.newPt)  # disabled

# ---- group: Changing the value for x in a function
panel_12 = Panel("19")  # disabled
panel_13 = Panel("0")  # disabled
c_script_7 = CSharpScript(x=panel_12, y=panel_13, z=panel_13)  # -> out, Point; inputs x: Double, y: Double, z: Double; disabled
# ---------- c_script_7: C# ----------
    Point3d pt = new Point3d (x, y, z);
    Print("Before the Change.X = " + pt.X);

    ChangeX(pt);

    Print("After the Change.X = " + pt.X);
    Point = pt;
# ---------- c_script_7: C# additional code ----------
  public void ChangeX (Point3d pt){
    pt.X = 100;
    Print("Inside the Change.X =" + pt);
  }
# ---------- end c_script_7 ----------
panel_14 = Panel(c_script_7.out)  # disabled
panel_15 = Panel(c_script_7.Point)  # disabled

# ---- group: Checks if the list of points are co-planar
panel_16 = Panel("""4,5,6
1,1,6
0,0,6""")  # disabled
panel_17 = Panel("0.01")  # disabled
c_script_8 = CSharpScript(pts=panel_16, tolerance=panel_17)  # -> out, IsCoPlanar; inputs pts: list of Point3d, tolerance: Double; disabled
# ---------- c_script_8: C# ----------
    //Test if the list of input points are coplanar
    bool coplaner = Point3d.ArePointsCoplanar(pts, tolerance);
    
    //assign the co-planar test to output
    IsCoPlanar = coplaner;
# ---------- end c_script_8 ----------
panel_18 = Panel(c_script_8.IsCoPlanar)  # disabled

# ---- group: Sums two points together
panel_19 = Panel("1,2,3")  # disabled
panel_20 = Panel("3,2,1")  # disabled
c_script_9 = CSharpScript(pt1=panel_20, pt2=panel_19)  # -> out, sumpt; inputs pt1: Point3d, pt2: Point3d; disabled
# ---------- c_script_9: C# ----------
    sumpt = pt1 + pt2;
# ---------- end c_script_9 ----------
panel_21 = Panel(c_script_9.sumpt)  # disabled

# ---- group: Creating vectors and points
c_script_10 = CSharpScript()  # -> out, Point0, Point1, Vector0, Vector1
# ---------- c_script_10: C# ----------
    Point3d p0 = new Point3d (3, 6, 0);
    Vector3d v0 = new Vector3d (4, 1.5, 0);
    //double factor = 0.5;

    Point3d p1 = new Point3d(Point3d.Unset);
    p1 = p0 + v0;

    double distance = p0.DistanceTo(p1);
    Vector3d v1 = new Vector3d (Vector3d.Unset);
    v1 = Point3d.Origin - p0;

    Vector3d addVectors = new Vector3d (Vector3d.Unset);
    addVectors = v0 + v1;

    Vector3d subractVectors = v0 - v1;

    double dot = v0 * v1;

    Point0 = p0;
    Point1 = p1;
    Vector0 = v0;
    Vector1 = v1;
# ---------- end c_script_10 ----------
vector = Vector(c_script_10.Vector1)
vector_2 = Vector(c_script_10.Vector0)
point_4 = Point(c_script_10.Point1)
point_5 = Point(c_script_10.Point0)
vector_display = VectorDisplay(Anchor=point_4, Vector=vector)
vector_display_2 = VectorDisplay(Anchor=point_5, Vector=vector_2)
